# Grasshopper definition DetailedWaterTower.gh (Grasshopper 0.9.76)

window_amount = Slider(8, range=0..15)
framing_thickness = Slider(0.22, range=0..1)
stem_level_height = Slider(3.5, range=1..5)
framing_shift = Slider(2, range=0..15)
tower_height = Slider(180, range=0..300)
level_thickness = Slider(2, range=0..5)
elevator_thickness = Slider(2.01, range=0..4)
leaf_angle = Slider(3.166, range=0..6.283)
stem_gap_radius = Slider(2.3, range=0..10)
road_thickness = Slider(3, range=0..10)
pavement_depth = Slider(0.558, range=0..1)
leaf_amount = Slider(6, range=1..7)
road_amount = Slider(4, range=0..10)
stem_radius = Slider(7.4, range=1..20)
random_seed = Slider(0, range=0..100)
randomise_angle = BooleanToggle(True)
# Some of these can take quite a while to load if you edit anything, so better not to just drag them
tower_base = Point(Point(-43.28271552, 46.3226775, 0))
detailed_water_tower_generation = DetailedWaterTowerGeneration(
    tower_base=tower_base,
    level_thickness=level_thickness,
    tower_height=tower_height,
    leaf_angle=leaf_angle,
    stem_radius=stem_radius,
    randomised_angles=randomise_angle,
    leaf_amount=leaf_amount,
    stem_gap_radius=stem_gap_radius,
    elevator_thickness=elevator_thickness,
    stem_level_height=stem_level_height,
    framing_thickness=framing_thickness,
    window_amount=window_amount,
    framing_shift=framing_shift,
    road_thickness=road_thickness,
    road_amount=road_amount,
    random_seed=random_seed,
    pavement_depth=pavement_depth)  # -> tower_2, facade_2, floors_2, elevators_2, glass_2
glass = Brep(detailed_water_tower_generation.glass_2)
elevators = Data(detailed_water_tower_generation.elevators_2)
floors = Brep(detailed_water_tower_generation.floors_2)
leaves = Brep(detailed_water_tower_generation.tower_2)
facade = Brep(detailed_water_tower_generation.facade_2)

# ==== cluster DetailedWaterTowerGeneration
tower_height = ClusterInput()
tower_base = ClusterInput()
stem_radius = ClusterInput()
leaf_amount = ClusterInput()
level_thickness = ClusterInput()
randomised_angles = ClusterInput()
leaf_angle = ClusterInput()
pavement_depth = ClusterInput()
stem_gap_radius = ClusterInput()
random_seed = ClusterInput()
elevator_thickness = ClusterInput()
stem_level_height = ClusterInput()
road_amount = ClusterInput()
framing_thickness = ClusterInput()
window_amount = ClusterInput()
road_thickness = ClusterInput()
framing_shift = ClusterInput()
randomised_angles_2 = Boolean(randomised_angles)
level_thickness_2 = Data(level_thickness)
window_amount_2 = Data(window_amount)
framing_thickness_2 = Data(framing_thickness)
tower_base_2 = Point(tower_base)
stem_level_height_2 = Data(stem_level_height)
stem_gap_radius_2 = Data(stem_gap_radius)
elevator_thickness_2 = Data(elevator_thickness)
stem_radius_2 = Data(stem_radius)
pavement_depth_2 = Data(pavement_depth)
tower_height_2 = Data(tower_height)
leaf_amount_2 = Data(leaf_amount)
leaf_angle_2 = Data(leaf_angle)
framing_shift_2 = Data(framing_shift)
road_thickness_2 = Data(road_thickness)
random_seed_2 = Data(random_seed)
road_amount_2 = Data(road_amount)
Z = UnitZ(Factor=tower_height_2)
move = Move(Geometry=tower_base_2, Motion=Z)  # -> Geometry, Transform
range = Range(Domain=Domain(0.1, 1), Steps=expr("x+1", leaf_amount_2))
number_slider = Slider(1, range=0..1)
division = Division(A=tower_height_2, B=stem_level_height_2)
random = Random(Range=Domain(0, 6.283), Number=leaf_amount_2, Seed=random_seed_2)
ln = Line(StartPoint=tower_base_2, EndPoint=move.Geometry)
round = Round(Number=division)  # -> Nearest, Floor, Ceiling
multiplication = Multiplication(A=random, B=randomised_angles_2)
split = SplitList(List=range, Index=number_slider)  # -> ListA, ListB
addition = Addition(A=leaf_angle_2, B=multiplication)
leaf_base_point = Point(Point(3.896008657, -18.35570401, 0))
range_2 = Range(Domain=Domain(0, 1), Steps=expr("x+1", round.Nearest))
inslice_point = Point(Point(56.6224782, -14.81402187, 0))
bend_point = Point(Point(31.42760789, -19.48395009, 0))
split_2 = SplitList(List=split.ListB, Index=leaf_amount_2)  # -> ListA, ListB
split_3 = SplitList(List=range_2, Index=number_slider)  # -> ListA, ListB
crv = Curve(<curve referenced from the Rhino model>)
merge = Merge(Data1=leaf_base_point, Data2=bend_point, Data3=inslice_point)
dom = ConstructDomain(DomainStart=Slider(1, range=0..1), DomainEnd=Slider(0.4476, range=0..1))
eval = EvaluateCurve(Curve=ln, Parameter=split_2.ListA)  # -> Point, Tangent, Angle
dom_2 = ConstructDomain(DomainStart=Slider(0, range=0..1), DomainEnd=Slider(0.3929, range=0..1))
split_4 = SplitList(List=split_3.ListB, Index=round.Nearest)  # -> ListA, ListB
intcrv = Interpolate(Vertices=merge, Degree=3, Periodic=False, KnotStyle=1)  # -> Curve, Length, Domain
subcrv = SubCurve(BaseCurve=reparameterize(crv), Domain=dom)
subcrv_2 = SubCurve(BaseCurve=reparameterize(crv), Domain=dom_2)
addition_2 = Addition(A=stem_gap_radius_2, B=elevator_thickness_2)
range_3 = Range(Domain=Domain(0.08, 0.35), Steps=road_amount_2)
range_4 = Range(Domain=Domain(0, 0.9), Steps=road_amount_2)
merge_2 = Merge(Data1=subcrv_2, Data2=subcrv)
eval_2 = EvaluateCurve(Curve=ln, Parameter=split_4.ListA)  # -> Point, Tangent, Angle
number_slider_2 = Slider(1, range=0..1)
join = JoinCurves(Curves=merge_2, Preserve=False)
cyl = Cylinder(Base=tower_base_2, Radius=stem_gap_radius_2, Length=tower_height_2)
cyl_2 = Cylinder(Base=tower_base_2, Radius=addition_2, Length=tower_height_2)
xy = XYPlane(Origin=eval_2.Point)
cyl_3 = Cylinder(Base=tower_base_2, Radius=stem_radius_2, Length=tower_height_2)
xz = XZPlane(Origin=tower_base_2)
yz = YZPlane(Origin=tower_base_2)
random_2 = Random(Range=Domain(-0.018, 0.018), Number=road_amount_2, Seed=expr("x*3-7", random_seed_2))
end = EndPoints(Curve=join)  # -> Start, End
random_3 = Random(Range=Domain(-0.018, 0.018), Number=road_amount_2, Seed=random_seed_2)
split_5 = SplitList(List=range_3, Index=number_slider_2)  # -> ListA, ListB
cap = CapHoles(Brep=cyl_3)
cap_2 = CapHoles(Brep=cyl_2)
split_6 = SplitList(List=range_4, Index=number_slider_2)  # -> ListA, ListB
cap_3 = CapHoles(Brep=cyl)
ln_2 = Line(StartPoint=end.Start, EndPoint=inslice_point)
ln_3 = Line(StartPoint=inslice_point, EndPoint=end.End)
addition_3 = Addition(A=split_5.ListB, B=random_3)
merge_3 = Merge(Data1=yz, Data2=xz)
subtraction = Subtraction(A=number_slider_2, B=split_5.ListB)
sdiff = SolidDifference(BrepsA=cap, BrepsB=cap_2)
sdiff_2 = SolidDifference(BrepsA=cap_2, BrepsB=cap_3)
merge_4 = Merge(Data1=ln_2, Data2=ln_3, Data3=join)
Z_2 = UnitZ(Factor=pavement_depth_2)
addition_4 = Addition(A=subtraction, B=random_2)
pbs = PythonScript(brp=sdiff_2, pln=merge_3)  # -> pieces; inputs brp: Brep, pln: list of Plane
# ---------- pbs: Python ----------
import rhinoscriptsyntax as rs
import Rhino as rh
import System as sys
import scriptcontext as sc

""" S
Split Brep plane 2012, 
by Arie-Willem de Jongh
"""


arrBrep =[]
arrBrep.append(brp)

if brp and pln:
    
    bb = rh.Geometry.Brep.GetBoundingBox(brp,rh.Geometry.Plane.WorldXY)
    
    for i in pln:
        bool,extU,extV = rh.Geometry.Plane.ExtendThroughBox(i,bb)
        extU.T0 = extU.T0 - 1
        extU.T1 = extU.T1 + 1
        extV.T0 = extV.T0 - 1
        extV.T1 = extV.T1 + 1
        
        planeSrf = rh.Geometry.PlaneSurface(i,extU,extV)
        splitter = planeSrf.ToBrep()
        arrBrepC = arrBrep[:]
        for j in arrBrepC:
            brep = rs.coercebrep(j)
            tbrep = brep.Split(splitter,0.001)
            if tbrep:
                arrBrep.remove(j)
                for k in tbrep:
                    h=k.CapPlanarHoles(0.001)
                    if h:
                        arrBrep.append(h)
                    else:
                        arrBrep.append(k)

pieces = arrBrep
# ---------- end pbs ----------
join_2 = JoinCurves(Curves=merge_4, Preserve=False)
debrep = DeconstructBrep(Brep=cyl_3)  # -> Faces, Edges, Vertices
data = Data(pbs)
number_slider_3 = Slider(0.5, range=0..1)
eval_3 = EvaluateCurve(Curve=reparameterize(join), Parameter=addition_3)  # -> reverse(Point), Tangent, Angle
eval_4 = EvaluateCurve(Curve=reparameterize(intcrv.Curve), Parameter=split_6.ListB)  # -> Point, Tangent, Angle
move_2 = Move(Geometry=join_2, Motion=Z_2)  # -> Geometry, Transform
pbs_2 = PythonScript(brp=sdiff, pln=xy)  # -> flatten(pieces); inputs brp: Brep, pln: list of Plane; same code as pbs
eval_5 = EvaluateCurve(Curve=reparameterize(join), Parameter=addition_4)  # -> reverse(Point), Tangent, Angle
pbs_3 = PythonScript(brp=data, pln=xy)  # -> flatten(pieces); inputs brp: Brep, pln: list of Plane; same code as pbs
number_slider_4 = Slider(4, range=0..5)
Z_3 = UnitZ(Factor=level_thickness_2)
range_5 = Range(Domain=Domain(0, 1), Steps=window_amount_2)
ln_4 = Line(StartPoint=eval_3.Point, EndPoint=eval_4.Point)
data_2 = Data(pbs_2)
ln_5 = Line(StartPoint=eval_5.Point, EndPoint=eval_4.Point)
item = ListItem(List=debrep.Edges, Index=0, Wrap=True)  # -> Item1, Item
neg = Negative(Value=Z_3)
split_7 = SplitList(List=range_5, Index=Slider(1, range=0..1))  # -> ListA, ListB
debrep_2 = DeconstructBrep(Brep=data_2)  # -> Faces, Edges, Vertices
eval_6 = EvaluateCurve(Curve=reparameterize(ln_4), Parameter=number_slider_3)  # -> Point, Tangent, Angle
boundary = BoundarySurfaces(Edges=move_2.Geometry)
eval_7 = EvaluateCurve(Curve=reparameterize(ln_5), Parameter=number_slider_3)  # -> Point, Tangent, Angle
item_2 = ListItem(List=debrep_2.Faces, Index=number_slider_4, Wrap=True)
intcrv_2 = Interpolate(Vertices=eval_7.Point, Degree=3, Periodic=False, KnotStyle=1)  # -> Curve, Length, Domain
eval_8 = EvaluateCurve(Curve=reparameterize(item.Item1), Parameter=split_7.ListB)  # -> reverse(Point), Tangent, Angle
eval_9 = EvaluateCurve(Curve=reparameterize(item.Item), Parameter=split_7.ListB)  # -> Point, Tangent, Angle
intcrv_3 = Interpolate(Vertices=eval_6.Point, Degree=3, Periodic=False, KnotStyle=1)  # -> Curve, Length, Domain
extr = Extrude(Base=boundary, Direction=neg)
debrep_3 = DeconstructBrep(Brep=item_2)  # -> Faces, Edges, Vertices
number_slider_5 = Slider(1.26, range=0..2)
shift = ShiftList(List=eval_9.Point, Shift=framing_shift_2, Wrap=True)
eval_10 = EvaluateCurve(Curve=reparameterize(intcrv_2.Curve), Parameter=number_slider_3)  # -> Point, Tangent, Angle
eval_11 = EvaluateCurve(Curve=reparameterize(intcrv_3.Curve), Parameter=number_slider_3)  # -> Point, Tangent, Angle
item_3 = ListItem(List=debrep_3.Edges, Index=number_slider_4, Wrap=True)
ln_6 = Line(StartPoint=eval_8.Point, EndPoint=shift)
pipe = Pipe(Curve=item_3, Radius=framing_thickness_2, Caps=0)  # -> flatten(Pipe)
scale = Scale(Geometry=intcrv_2.Curve, Center=eval_10.Point, Factor=number_slider_5)  # -> Geometry, Transform
scale_2 = Scale(Geometry=intcrv_3.Curve, Center=eval_11.Point, Factor=number_slider_5)  # -> Geometry, Transform
eval_12 = EvaluateCurve(Curve=ln_6, Parameter=Slider(0.5, range=0..1))  # -> Point, Tangent, Angle
area = Area(Geometry=cyl_3)  # -> Area, Centroid
eval_13 = EvaluateCurve(Curve=reparameterize(scale.Geometry), Parameter=split_6.ListB)  # -> Point, Tangent, Angle
eval_14 = EvaluateCurve(Curve=reparameterize(scale_2.Geometry), Parameter=split_6.ListB)  # -> Point, Tangent, Angle
vec2pt = Vector2Pt(PointA=area.Centroid, PointB=eval_12.Point, Unitize=False)  # -> Vector, Length
project = Project(Curve=ln_6, Brep=debrep.Faces, Direction=vec2pt.Vector)
merge_5 = Merge(Data1=graft(eval_4.Point), Data2=graft(eval_14.Point), Data3=graft(eval_3.Point))
merge_6 = Merge(Data1=graft(eval_4.Point), Data2=graft(eval_13.Point), Data3=graft(eval_5.Point))
pipe_2 = Pipe(Curve=project, Radius=framing_thickness_2, Caps=0)  # -> flatten(Pipe)
intcrv_4 = Interpolate(Vertices=merge_5, Degree=3, Periodic=False, KnotStyle=1)  # -> flatten(Curve), Length, Domain
intcrv_5 = Interpolate(Vertices=merge_6, Degree=3, Periodic=False, KnotStyle=1)  # -> flatten(Curve), Length, Domain
merge_7 = Merge(Data1=pipe_2, Data2=pipe)
merge_8 = Merge(Data1=intcrv.Curve, Data2=intcrv_4.Curve, Data3=intcrv_5.Curve)
pipe_3 = Pipe(Curve=merge_8, Radius=expr("x/2", road_thickness_2), Caps=0)  # -> flatten(Pipe)
cap_4 = CapHoles(Brep=pipe_3)
sunion = SolidUnion(Breps=cap_4)
sec = BrepPlane(Brep=sunion, Plane=PlaneXY(0, 0, 0))  # -> Curves, Points
extr_2 = Extrude(Base=sec.Curves, Direction=Z_2)
project_2 = Project(Curve=sec.Curves, Brep=boundary, Direction=Vector(0, 0, 1))
cap_5 = CapHoles(Brep=extr_2)
sdiff_3 = SolidDifference(BrepsA=extr, BrepsB=cap_5)
pipe_4 = Pipe(Curve=project_2, Radius=expr("x/2", pavement_depth_2), Caps=1)
merge_9 = Merge(Data1=sdiff_3, Data2=pipe_4)  # -> flatten(Result)
rotate = Rotate(Geometry=graft(merge_9), Angle=addition, Plane=leaf_base_point)  # -> Geometry, Transform
vec2pt_2 = Vector2Pt(PointA=leaf_base_point, PointB=eval.Point, Unitize=False)  # -> Vector, Length
move_3 = Move(Geometry=rotate.Geometry, Motion=vec2pt_2.Vector)  # -> Geometry, Transform
tower = Brep(move_3.Geometry)
tower_2 = ClusterOutput(tower)
facade = Brep(merge_7)
facade_2 = ClusterOutput(facade)
elevators = Data(pbs_3)
elevators_2 = ClusterOutput(elevators)
floors = Brep(item_2)
floors_2 = ClusterOutput(floors)
glass = Brep(debrep.Faces)
glass_2 = ClusterOutput(glass)
