# Grasshopper definition SimplifiedWaterTower.gh (Grasshopper 0.9.76)

level_thickness = Slider(2, range=0..5)
tower_height = Slider(180, range=0..300)
leaf_amount = Slider(6, range=1..7)
stem_radius = Slider(5.6, range=1..20)
randomise_angle = BooleanToggle(True)
leaf_angle = Slider(2.764, range=0..6.283)
tower_base = Point(Point(-43.28271552, 46.3226775, 0))
simple_water_tower = SimpleWaterTower(
    tower_base=tower_base,
    level_thickness=level_thickness,
    tower_height=tower_height,
    leaf_angle=leaf_angle,
    stem_radius=stem_radius,
    randomised_angles=randomise_angle,
    leaf_amount=leaf_amount)
tower = Brep(simple_water_tower)
deextrusion_1_1 = DeconstructExtrusion11(brep=tower)  # -> doc_2, G, bh_3, bh_4
orientne = OrientNE(G=deextrusion_1_1.G, P=tower_base)  # -> doc_2, G_3, pt_2
panel = Panel(orientne.doc_2)

# ==== cluster SimpleWaterTower
level_thickness = ClusterInput()
tower_base = ClusterInput()
randomised_angles = ClusterInput()
stem_radius = ClusterInput()
tower_height = ClusterInput()
random_seed = ClusterInput()
leaf_angle = ClusterInput()
leaf_amount = ClusterInput()
level_thickness_2 = Data(level_thickness)
tower_base_2 = Point(tower_base)
randomised_angles_2 = Boolean(randomised_angles)
stem_radius_2 = Data(stem_radius)
tower_height_2 = Data(tower_height)
leaf_angle_2 = Data(leaf_angle)
random_seed_2 = Data(random_seed)
leaf_amount_2 = Data(leaf_amount)
Z = UnitZ(Factor=tower_height_2)
range = Range(Domain=Domain(0.1, 1), Steps=expr("x+1", leaf_amount_2))
move = Move(Geometry=tower_base_2, Motion=Z)  # -> Geometry, Transform
leaf_base_point = Point(Point(3.896008657, -18.35570401, 0))
random = Random(Range=Domain(0, 6.283), Number=leaf_amount_2, Seed=random_seed_2)
crv = Curve(<curve referenced from the Rhino model>)
ln = Line(StartPoint=tower_base_2, EndPoint=move.Geometry)
multiplication = Multiplication(A=random, B=randomised_angles_2)
cyl = Cylinder(Base=tower_base_2, Radius=stem_radius_2, Length=tower_height_2)
split = SplitList(List=range, Index=Slider(1, range=0..1))  # -> ListA, ListB
addition = Addition(A=leaf_angle_2, B=multiplication)
split_2 = SplitList(List=split.ListB, Index=leaf_amount_2)  # -> ListA, ListB
rotate = Rotate(Geometry=crv, Angle=addition, Plane=leaf_base_point)  # -> Geometry, Transform
cap = CapHoles(Brep=cyl)
eval = EvaluateCurve(Curve=ln, Parameter=split_2.ListA)  # -> Point, Tangent, Angle
vec2pt = Vector2Pt(PointA=leaf_base_point, PointB=eval.Point, Unitize=False)  # -> Vector, Length
move_2 = Move(Geometry=rotate.Geometry, Motion=vec2pt.Vector)  # -> Geometry, Transform
Z_2 = UnitZ(Factor=level_thickness_2)
boundary = BoundarySurfaces(Edges=move_2.Geometry)
extr = Extrude(Base=boundary, Direction=Z_2)
merge = Merge(Data1=extr, Data2=cap)
tower = Brep(merge)
tower_2 = ClusterOutput(tower)

# ==== cluster DeconstructExtrusion11: Deconstructs simple extrusions into polylines, heights, and base heights for later use in ‘Polygon to GeoJSON component’.
brep = ClusterInput()
brep_2 = Brep(simplify(graft(brep)))
cap = CapHoles(Brep=brep_2)
mesh = MeshBrep(
    Brep=cap,
    Settings={GridMaxCount=0, GridMinCount=16, JaggedSeams=False, MaxEdgeLength=0, MinEdgeLength=0.0001, MinTolerance=0, Refine=True, RefineAngle=0, RelativeTolerance=0.65, SimplePlanes=True, Tolerance=0})
mshadow = MeshShadow(Mesh=mesh, Light=Vector(0, 0, -1), Plane=PlaneXY(0, 0, 0))
demesh = DeconstructMesh(Mesh=mesh)  # -> Vertices, Faces, Colours, Normals
pdecon = Deconstruct(Point=demesh.Vertices)  # -> XComponent, YComponent, ZComponent
panel = Panel("Deconstructs simple extrusions into polylines, heights, and base heights for later use in ‘Polygon to GeoJSON component’.")
panel_2 = Panel(""" 
INPUTS: 

Brep (B) - Extruded or capped Breps. Must be extruded in the z axis. """)
panel_3 = Panel("""OUTPUTS:

Polyline (Crv)- Projected base polyline of Brep.

Height (H) - Height of Brep.The distance of extrusion. 

Base Height (BH) - The height of the base of the brep from the ground XY Plane.""")
sort = SortList(Keys=pdecon.ZComponent)  # -> Keys, ValuesA
item = ListItem(List=sort.Keys, Index=0, Wrap=True)  # -> Item1, Item
panel_4 = Panel("For more documentation visit: github.com/madeleinejohanson/Humpback")
subtraction = Subtraction(A=item.Item1, B=item.Item)
bh = Data(simplify(flatten(subtraction)))
bh_2 = Data(simplify(flatten(item.Item)))
Z = UnitZ(Factor=bh_2)
merge = Merge(Data1="DECONSTRUCT EXTRUSION", Data2=panel, Data3=panel_2, Data4=panel_3, Data5=panel_4)
move = Move(Geometry=flatten(mshadow), Motion=Z)  # -> Geometry, Transform
doc = Text(merge)
doc_2 = ClusterOutput(doc)
panel_5 = Panel(doc)

# ---- group: Cluster Output
bh_3 = ClusterOutput(bh)

# ----
bh_4 = ClusterOutput(bh_2)
G = ClusterOutput(move.Geometry)

# ==== cluster OrientNE: Orients geometry
panel = Panel("Orients geometry to specified Northing and Easting Coordinates")
panel_2 = Panel("""OUTPUTS:

Geometry (G) - Reoriented geometry

Point (Pt) - Coordinates represented as a point""")
panel_3 = Panel(""" 
INPUTS: 

Geometry (G) - Geometry to move.

Initial Plane (P) - Plane to move geometry from.

Northing (N) - Specified Northing coordinates as floating point 
eg. -33.857702

Easting(E) - Specified Easting coordinates as floating point 
eg. 151.203655""")
E = ClusterInput()
N = ClusterInput()
P = ClusterInput()
G = ClusterInput()
number_slider = Slider(100000, range=0..100000)
xy = XYPlane(Origin=Point(0, 0, 0))
E_2 = Number(E)
N_2 = Number(N)
G_2 = Geometry(G)
P_2 = Source(P)
panel_4 = Panel("For more documentation visit: github.com/madeleinejohanson/Humpback")
merge = Merge(Data1=P, Data2=xy)
multiplication = Multiplication(A=N_2, B=number_slider)
multiplication_2 = Multiplication(A=E_2, B=number_slider)
item = ListItem(List=merge, Index=0, Wrap=True)
pt = ConstructPoint(XCoordinate=multiplication_2, YCoordinate=multiplication, ZCoordinate=0)
orient = Orient(Geometry=G_2, Source=item, Target=pt)  # -> Geometry, Transform
G_3 = ClusterOutput(orient.Geometry)
pt_2 = ClusterOutput(pt)
merge_2 = Merge(Data1="ORIENT(N,E)", Data2=panel, Data3=panel_3, Data6=panel_2, Data7=panel_4)
doc = Text(merge_2)
doc_2 = ClusterOutput(doc)
panel_5 = Panel(doc)
